# Grasshopper definition Sun_Hours.ghx (Grasshopper 1.0.8)
# plug-ins: Outdoor, Eddy3D, Eddy3D-Radiance

# ---- group: Ground Surface
brep = Brep(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)

# ----
context = Brep([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])
download_weather = DownloadWeather(Search="Atlanta")  # -> EPWFile, Logs, Stations
brep_grid_points = BrepGridPoints(Geometry=brep, Spacing=Slider(2, range=0..10))  # -> Points, Vectors, Mesh, Status
deconstruct_weather = DeconstructWeather(Weather=download_weather.EPWFile)  # -> DryBulbTemperature, RelativeHumidity, WindSpeed, WindDirection, SolarElevation, SolarAzimuth
sun_hours = SunHours(
    Context=context,
    Points=brep_grid_points.Points,
    SunElevation=deconstruct_weather.SolarElevation,
    SunAzimuth=deconstruct_weather.SolarAzimuth,
    StartHour=0,
    EndHour=8760,
    Offset=0.01)  # -> SunHours, Fraction, Colors, Report
panel = Panel(sun_hours.Report)

# ---- group: Mean
bnd = Bounds(Numbers=sun_hours.SunHours)
dedomain = DeconstructDomain(Domain=bnd)  # -> Start, End
gradient = Gradient(
    LowerLimit=dedomain.Start,
    UpperLimit=dedomain.End,
    Parameter=sun_hours.SunHours,
    stops=[0: RGB(48, 18, 59), 0.0294: RGB(56, 40, 112), 0.0588: RGB(63, 62, 156), 0.0882: RGB(68, 82, 193), 0.118: RGB(70, 102, 221), 0.147: RGB(71, 122, 241)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])
cir = Circle(Plane=brep_grid_points.Points, Radius=1)
srf = Surface(cir)
round = Round(Number=sun_hours.SunHours)  # -> Nearest, Floor, Ceiling
preview = CustomPreview(Geometry=srf, Material=gradient)
tag = TextTag(Location=brep_grid_points.Points, Text=round.Nearest, Colour=ColourSwatch(SwatchColor=RGB(255, 255, 255)))
